# Grasshopper definition test.gh (Grasshopper 1.0.7)
# plug-ins: Transfinite

panel = Panel("132.191 109.775 3.38065 123.46 116.194 11.2296 108.597 127.461 21.0665 92.0275 137.526 13.0152 83.9708 142.896 8.24165")
panel_2 = Panel("83.9708 142.896 8.24165 56.2923 127.796 9.87244 24.0174 118.532 8.4064 -7.25685 116.377 5.19098")
panel_3 = Panel("100 -100 0 99.065 -68.6247 -0.632911 101.652 -15.9413 -0.711095 115.079 54.0322 1.48612 126.276 92.4937 3.66448 132.191 109.775 3.38065")
panel_4 = Panel("0.019329 11.8409 8.48475 13.1342 12.0097 8.47983 51.8205 -2.19188 8.49852 58.3194 -57.8379 8.16055 55.7628 -90.3898 8.64392 53.9182 -100 8.47485")
panel_5 = Panel("-7.25685 116.377 5.19098 -6.20675 98.9834 18.6448 -4.03982 64.015 31.614 -0.726455 28.2153 16.9218 0.019329 11.8409 8.48475")
panel_6 = Panel("53.9182 -100 8.47485 61.3858 -99.653 11.4727 79.049 -100.186 15.9436 93.0327 -100 7.21678 100 -100 0")
cluster = Cluster(pt=panel, K="0 0 0 0.545052 1 1 1")  # -> pt_3, K_2
cluster_2 = Cluster(pt=panel_2, K="0 0 0 1 1 1")  # -> pt_3, K_2
cluster_3 = Cluster(pt=panel_5, K="0 0 0 0.518535 1 1 1")  # -> pt_3, K_2
cluster_4 = Cluster(pt=panel_4, K="0 0 0 0.270352 0.795435 1 1 1")  # -> pt_3, K_2
cluster_5 = Cluster(pt=panel_6, K="0 0 0 0.482422 1 1 1")  # -> pt_3, K_2
cluster_6 = Cluster(pt=panel_3, K="0 0 0 0.437553 0.74263 1 1 1")  # -> pt_3, K_2
nurbcrv = NurbsCurvePWK(Points=flatten(cluster_4.pt_3), Knots=cluster_4.K_2)  # -> Curve, Length, Domain
nurbcrv_2 = NurbsCurvePWK(Points=flatten(cluster.pt_3), Knots=cluster.K_2)  # -> Curve, Length, Domain
nurbcrv_3 = NurbsCurvePWK(Points=flatten(cluster_2.pt_3), Knots=cluster_2.K_2)  # -> Curve, Length, Domain
nurbcrv_4 = NurbsCurvePWK(Points=flatten(cluster_3.pt_3), Knots=cluster_3.K_2)  # -> Curve, Length, Domain
nurbcrv_5 = NurbsCurvePWK(Points=flatten(cluster_5.pt_3), Knots=cluster_5.K_2)  # -> Curve, Length, Domain
nurbcrv_6 = NurbsCurvePWK(Points=flatten(cluster_6.pt_3), Knots=cluster_6.K_2)  # -> Curve, Length, Domain
panel_7 = Panel("0.5")
panel_8 = Panel("""0.3
0.6""")
num = Number(panel_8)
shatter = Shatter(Curve=nurbcrv.Curve, Parameters=num)
flatten = FlattenTree(Tree=shatter, Path="{0;0}")
crv = Curve([<curve referenced from the Rhino model> x5])
merge = Merge(
    Data1=nurbcrv_2.Curve,
    Data2=nurbcrv_3.Curve,
    Data3=nurbcrv_4.Curve,
    Data4=nurbcrv.Curve,
    Data5=nurbcrv_5.Curve,
    Data6=nurbcrv_6.Curve)
item = ListItem(List=merge, Index=Slider(10, range=0..10), Wrap=True)
list = ValueList({"Harmonic Point": 3, "Radial Distance Function": 4}, selected="Harmonic Point")
list_2 = ValueList({"Special Side Blending": 2}, selected="Special Side Blending")
item_2 = ListItem(List=crv, Index=Slider(2, range=0..10), Wrap=True)
transfinite = TransfiniteSurface(Curves=merge, Parametrization=list, Blending=list_2)  # -> Model, DomainC, DomainV
divide = DivideCurve(Curve=item_2, Count=10, Kinks=False)  # -> Points, Tangents, Parameters
crvgraph = CurvatureGraph(Density=5, Scale=105)
cdiv = Derivatives(Curve=item_2, Parameter=divide.Parameters)  # -> Point, FirstDerivative

# ==== cluster Cluster
K = ClusterInput()  # K
pt = ClusterInput()  # Pt
split = TextSplit(Text=pt, Separators=" ")
split_2 = TextSplit(Text=K, Separators=" ")
partition = PartitionList(List=split, Size=3)
item = ListItem(List=partition, Index=0, Wrap=True)  # -> Item, Item1, Item2
pt_2 = ConstructPoint(XCoordinate=item.Item, YCoordinate=item.Item1, ZCoordinate=item.Item2)
K_2 = ClusterOutput(split_2)  # K
pt_3 = ClusterOutput(pt_2)  # Pt
